# Grasshopper definition A2Shape.gh (Grasshopper 1.0.8)

circle = Circle(Plane=PlaneXY(0, 0, 0), Radius=Slider(0.5, range=0..1))
rectangle = Rectangle(Plane=PlaneXY(0, 0, 0), XSize=Slider(0.138, range=0..100), YSize=Slider(0.5, range=0..10), Radius=0)  # -> Rectangle, Length
vector_xyz = VectorXYZ(XComponent=Slider(-1.5, range=-3..3), YComponent=Slider(-1.5, range=-100..101), ZComponent=0)  # -> Vector, Length
rectangle_2 = Rectangle(Plane=PlaneXY(0, 0, 0), XSize=Slider(3, range=0..100), YSize=Slider(3, range=0..100), Radius=0)  # -> Rectangle, Length
vector_xyz_2 = VectorXYZ(XComponent=Slider(-0.069, range=-3..16), YComponent=Slider(1, range=0..2), ZComponent=0)  # -> Vector, Length
move = Move(Geometry=rectangle.Rectangle, Motion=vector_xyz_2.Vector)  # -> Geometry, Transform
vector_xyz_3 = VectorXYZ(XComponent=Slider(1.5, range=-3..16), YComponent=Slider(1.5, range=0..2), ZComponent=0)  # -> Vector, Length
move_2 = Move(Geometry=rectangle_2.Rectangle, Motion=vector_xyz.Vector)  # -> Geometry, Transform
move_3 = Move(Geometry=circle, Motion=vector_xyz_3.Vector)  # -> Geometry, Transform
polar_array = PolarArray(Geometry=move.Geometry, Plane=PlaneXY(0, 0, 0), Count=Slider(4, range=0..16), Angle=6.283185307)  # -> Geometry, Transform
polar_array_2 = PolarArray(Geometry=move_3.Geometry, Plane=PlaneXY(0, 0, 0), Count=Slider(4, range=0..16), Angle=6.283185307)  # -> Geometry, Transform
